# Grasshopper definition modelisation helios.gh (Grasshopper 0.9.61)
# plug-ins: Python Interpreter, gHowl, Firefly

toggle = BooleanToggle(False)
udp = UDPReceiver(Port=6201, Pattern=0)  # -> Info, Data; disabled
udp_2 = UDPReceiver(Port=6202, Pattern=0)  # -> Info, Data; disabled
log = DataLog(IncomingData=udp.Data, ResetLog=toggle, StartRecording=True, WrapValues=False, RecordingLength=0)
log_2 = DataLog(IncomingData=udp_2.Data, ResetLog=toggle, StartRecording=True, WrapValues=False, RecordingLength=0)
panel = Panel(log_2)
panel_2 = Panel(log)
C = Separators(";")
split = TextSplit(Text=log, Separators=C)
panel_3 = Panel(split)
dispatch = Dispatch(List=split, DispatchPattern=[True, True, False])  # -> ListA, ListB
dispatch_2 = Dispatch(List=dispatch.ListA, DispatchPattern=[True, False])  # -> ListA, ListB

c_users_verseau_desktop_helios_cells_dat = FilePath("C:\Users\verseau\Desktop\helios_cells\data\croisementsSomme.json")  # "C:\Users\verseau\Desktop\helios_cells\data"
json = PythonScript(PositionCroisement_json=c_users_verseau_desktop_helios_cells_dat)  # -> X
# ---------- json: Python ----------
import json

if FilePath:
    
    # JSON file to read
    file = open(FilePath)
    
    # Load the data
    data = json.load(file)
    xs = [item["x"] for item in data]
    
    # Do something with the data

print xs
# ---------- end json ----------
json_2 = PythonScript(PositionCroisement_json=c_users_verseau_desktop_helios_cells_dat)  # -> Y
# ---------- json_2: Python ----------
import json

if FilePath:
    
    # JSON file to read
    file = open(FilePath)
    
    # Load the data
    data = json.load(file)
    ys = [item["y"] for item in data]
    
    # Do something with the data
data2 = data[0]["y"]
print ys
# ---------- end json_2 ----------

panel_4 = Panel("list of 25600 points")
_159 = Integer(159)
sqgrid = Square(Plane=PlaneXY(0, 0, 0), Size=45, ExtentX=_159, ExtentY=_159)  # -> Cells, Points
pt = Point(sqgrid.Points)

panel_5 = Panel(json)
panel_6 = Panel(json_2)
pt_2 = ConstructPoint(XCoordinate=0, YCoordinate=0, ZCoordinate=0)
pt_3 = ConstructPoint(XCoordinate=45, YCoordinate=45, ZCoordinate=45)
box = Box2Pt(PointA=pt_2, PointB=pt_3, Plane=PlaneXY(0, 0, 0))

split_2 = TextSplit(Text=panel_5, Separators=",")
split_3 = TextSplit(Text=panel_6, Separators=",")
lng = ListLength(List=split_2)
lng_2 = ListLength(List=split_3)
subtraction = Subtraction(A=lng, B=2)
subtraction_2 = Subtraction(A=lng_2, B=2)
cull_i = CullIndex(List=split_2, Indices=lng, Wrap=True)
cull_i_2 = CullIndex(List=split_3, Indices=lng_2, Wrap=True)
cull_i_3 = CullIndex(List=cull_i, Indices=subtraction, Wrap=True)
cull_i_4 = CullIndex(List=cull_i_2, Indices=subtraction_2, Wrap=True)

_45 = Number(45)
multiplication = Multiplication(A=cull_i_3, B=_45)
multiplication_2 = Multiplication(A=cull_i_4, B=_45)
panel_7 = Panel(multiplication_2)
panel_8 = Panel(multiplication)

pt_4 = ConstructPoint(XCoordinate=multiplication, YCoordinate=multiplication_2, ZCoordinate=0)
panel_9 = Panel(pt_4)

difference = SetDifference(SetA=pt, SetB=pt_4)
move = Move(Geometry=box, Motion=difference)  # -> Geometry, Transform
